% Requirement links of verify_abs.m (R2025b)

% lines 1-2 verifies abs_verification_rules.slreqx#3
% lines 1-2 verifies abs_verification_rules.slreqx#4
% lines 1-2 verifies abs_verification_rules.slreqx#5
% lines 1-2 verifies abs_verification_rules.slreqx#6
% lines 1-2 verifies abs_verification_rules.slreqx#7
% lines 1-2 verifies abs_verification_rules.slreqx#8
% lines 1-2 verifies abs_verification_rules.slreqx#9
% lines 1-2 verifies abs_verification_rules.slreqx#10
% lines 1-2 verifies abs_verification_rules.slreqx#11
% lines 1-2 verifies abs_verification_rules.slreqx#12
classdef verify_abs < matlab.unittest.TestCase
    methods(Test)